# Dynamo graph Calculate Ratio Between Room and Windows.dyn (Dynamo 2.2.1.5175)

# group: Rooms Collector
categories = Categories("OST_Rooms")
all_elements_of_category = ElementsOfCategory(Category=categories)

# group: Indentifies "Total Windows Area" Rooms Parameter
code_block = CodeBlock { "Total Windows Area"; }

# group: Finds the relationship between windows and rooms
windows = Custom[Room.Windows](room=all_elements_of_category)  # Retrieves all windows that are associated with a room (hosted in walls and roofs).
elementType = Element.ElementType(element=windows)

# group: Extract Windows "Windows Area" parameter value
code_block_2 = CodeBlock { "Windows Area"; }

# group: Get the Windows area for each room
parameterByName = Parameter.ParameterByName(element=elementType, name=code_block_2)
value = Parameter.Value(parameter=parameterByName)
sum = Math.Sum(values=value)

# group: Indentify the "ASSING A NAME" parameter, to be compliled with the ration between Windows Size and Square Meters.
code_block_3 = CodeBlock { "ASSING A NAME"; }

# group: Extract room's "Area" parameter value
code_block_4 = CodeBlock { "Area"; }

# group: Calculate the ration between the windows are and the floor Area in each Room
parameterByName_2 = Parameter.ParameterByName(element=all_elements_of_category, name=code_block)
value_2 = Parameter.Value(parameter=parameterByName_2)
parameterByName_3 = Parameter.ParameterByName(element=all_elements_of_category, name=code_block_4)
value_3 = Parameter.Value(parameter=parameterByName_3)
div = value_2 / value_3

# group: Writes the values in Rooms
setValue = Parameter.SetValue(parameter=parameterByName_2, value=sum)

# group: Compile the Ratio Parameter in Each Room
parameterByName_4 = Parameter.ParameterByName(element=all_elements_of_category, name=code_block_3)
code_block_5 = CodeBlock { 2; }
round = Math.Round(number=div, digits=code_block_5)
setValue_2 = Parameter.SetValue(parameter=parameterByName_4, value=round)
